# Grasshopper definition HilbertCurving.gh (Grasshopper 1.0.7)

crv = Curve(<curve referenced from the Rhino model>)
python = GhPythonScript(
    crvs=crv,
    GLOBAL_SCALE=Slider(0.7, range=0.2..100),
    max_depth=Slider(8, range=0..10),
    x=Slider(9.42, range=1..10),
    y=Slider(8.6, range=1..10),
    z=Slider(6.12, range=1..10),
    height=Slider(8.49, range=1..10))  # -> out, a; inputs crvs: list of Curve
# ---------- python: Python ----------
import os
import sys

file_name = ghenv.Component.OnPingDocument().FilePath

def get_parent(path, degree = 1):
    
    parent = path
    
    for i in range(degree):
        
        parent = os.path.dirname(parent)
        
    return parent
    
path = get_parent(file_name, 3)

sys.path.append(os.path.join(path, 'src') )

from spacemapping_curve.quadtree import *
import spacemapping_curve.distance as sdf
import spacemapping_curve.hilbertcurve as hc
import spacemapping_curve.combinations as co

import Rhino.Geometry as rg
import rhinoscriptsyntax as rs

reload(hc)
reload(sdf)
reload(co)

print("SchwarzG Domain: {}".format(sdf.SchwarzG().domain ) )
print("SchwarzP Domain: {}".format(sdf.SchwarzP().domain ) )
print("SchwarzD Domain: {}".format(sdf.SchwarzD().domain ) )
print("SchwarzW Domain: {}".format(sdf.SchwarzW().domain ) )
print("SchwarzN Domain: {}".format(sdf.SchwarzN().domain ) )
print("SchwarzPW Domain: {}".format(sdf.SchwarzPW().domain ) )
print("Lindinoid Domain: {}".format(sdf.Lindinoid().domain ) )
print("PinchD Domain: {}".format(sdf.PinchD().domain ) )
print("PinchP Domain: {}".format(sdf.PinchP().domain ) )
print("PinchG Domain: {}".format(sdf.PinchG().domain ) )
print("PinchW Domain: {}".format(sdf.PinchW().domain ) )


# ==============================================================================
# get distance value
# ==============================================================================
sdf.DistanceToCurve.GLOBAL_SCALE = GLOBAL_SCALE * 5
# sdf.FuckYouBernhardFunction.GLOBAL_SCALE = GLOBAL_SCALE

# sdf.SDF.X_SCALE = x
# sdf.SDF.Y_SCALE = y
# sdf.SDF.Z_SCALE = z

# sdf.FuckYouBernhardFunction.HEIGHT = height * z

crv_distance = sdf.DistanceToCurve(crvs)

pinch_d = sdf.PinchD(x, y, z, height, GLOBAL_SCALE, 10, -.5, 14)

gyroid = sdf.Gyroid(x, y, z, height, GLOBAL_SCALE * 10.0)

# structure = hc.BooleanUnion([crv_distance, pinch_d, gyroid])
structure = co.BooleanUnion([pinch_d, gyroid])

# ==============================================================================
# Main
# ==============================================================================

a = hc.draw_hc(200, max_depth, structure)
# ---------- end python ----------
panel = Panel("print(len(pts))")
crv_2 = Curve([<curve referenced from the Rhino model> x13])
python_2 = GhPythonScript(
    crvs=crv_2,
    GLOBAL_SCALE=Slider(0.7, range=0.2..100),
    max_depth=Slider(8, range=0..10),
    x=Slider(9.42, range=1..10),
    y=Slider(8.6, range=1..10),
    z=Slider(6.12, range=1..10),
    height=Slider(8.49, range=1..10))  # -> out, a; inputs crvs: list of Curve
# ---------- python_2: Python ----------
import os
import sys

file_name = ghenv.Component.OnPingDocument().FilePath

def get_parent(path, degree = 1):
    
    parent = path
    
    for i in range(degree):
        
        parent = os.path.dirname(parent)
        
    return parent
    
path = get_parent(file_name, 3)

sys.path.append(os.path.join(path, 'src') )

from spacemapping_curve.quadtree import *
from spacemapping_curve.distance import DistanceToCurve
from spacemapping_curve.hilbertcurve import draw_hc

import Rhino.Geometry as rg
import rhinoscriptsyntax as rs


# ==============================================================================
# get distance value
# ==============================================================================

crv_distance = DistanceToCurve(crvs)



pts = draw_hc(380, 8, crv_distance, return_pts=True)
##pl = draw_hc(200, 9, crv_distance, return_pts=False)
rgPoints = [rg.Point3d(*pt) for pt in pts]
##a = rgPoints
a = rs.AddPolyline(rgPoints)
# ---------- end python_2 ----------
curve = Curve(python_2.a)
