# Grasshopper definition HilbertGcode_1.gh (Grasshopper 1.0.7)

# ---- group: don't remove
python = GhPythonScript()  # -> out, path_general, path_gcode_lib, path_gcode_files
# ---------- python: Python ----------
import os

print(os.name)
os_name = str(os.name)

ghComp = ghenv.Component
ghDoc = ghComp.OnPingDocument()

path = str(ghDoc.FilePath)

parent = os.path.dirname(path)

if "posix" == os_name:
    
    print("I am a Mac")
    

elif "nt" == os_name:

    print("I am a Pc")

path_general = os.path.join(parent, "src", "spacemapping_curve")
path_gcode_lib = os.path.join(path_general,"gcode")
path_gcode_files = os.path.join(parent,"gcode")

print(path_general)
print(path_gcode_lib)
print(path_gcode_files)
# ---------- end python ----------
defaultmap = FilePath(python.path_general)
path = FilePath()
python_2 = GhPythonScript(default_dropbox_path=defaultmap, costum_path=path)  # -> out, path
# ---------- python_2: Python ----------
import sys
import scriptcontext as sc

if costum_path == None:
    path = default_dropbox_path
    
else:
    path = costum_path

sys.path.append(path)

sc.sticky["PrintSettings"] = {"library_path": path}
sc.sticky["PrintSettings"]["_project:"] = "hilbert_TPMS"
sc.sticky["PrintSettings"]["_project_by:"] = "WenqianYang, JonasWard"
sc.sticky["PrintSettings"]["_project_gcode_generator_by:"] = "JonasWard"
print(sys.path)
# ---------- end python_2 ----------

# ----
panel = Panel(python.out)
merge = Merge(Data1=Slider(3.1, range=0..100), Data2=Slider(77.8, range=0..100))
merge_2 = Merge(Data1=Slider(13.5, range=0..100), Data2=Slider(89.9, range=0..100))
crv = Curve(<curve referenced from the Rhino model>)
pt = Point([Point(120.2773554, 101.5225194, 0), Point(48.97591003, 86.30320507, 0), Point(77.53818492, 71.29237447, 0), Point(108.3937812, 31.26349286, 0), Point(61.27645177, 27.92775273, 0), Point(61.48493553, -10.85022633, 0)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])
gcodelines = GhPythonScript(x=python.path_gcode_lib)  # -> out, a, path_vis; inputs pts: list, variable_feed_rate: Boolean
# ---------- gcodelines: Python ----------
import sys

sys.path.append(x)

import Rhino.Geometry as rg
import simpleStartStop as ss

reload(ss)

# print(pts)

p_set = ss.PrintSettings(
    feed_rate = feed_rate, 
    extrusion_rate = extrusion_rate, 
    extrusion_mode = 'relative', 
    movement_mode = 'relative'
)

if variable_feed_rate:
    
    p_set.setComplexFeedrate(
        peak_feed_rate,
        min_h_ramp = (start_min, start_max),
        max_h_ramp = (end_max, end_min)
    )

l_type = ss.LinkType(
    link_type = link_type,
    global_trim_distance = global_trim_distance,
    ss_trim_distance = ss_trim_distance,
    cull_distance = cull_distance,
    lift_val = lift_val
)

l_type.ss_f_rate = ss_f_rate
l_type.ss_e_rate = ss_e_rate

gcodeset = ss.GCodeSet(pts, p_set, l_type)
a = gcodeset.generateGCode()

path_vis = gcodeset.path_vis
# ---------- end gcodelines ----------
python_3 = GhPythonScript(
    global_path=python.path_general,
    crvs=crv,
    GLOBAL_SCALE=Slider(0.7, range=0.2..100),
    max_depth=Slider(9, range=0..10),
    x=Slider(9.42, range=1..10),
    y=Slider(8.6, range=1..10),
    z=Slider(2.39, range=1..10),
    height=Slider(8.49, range=1..10))  # -> out, a; inputs crvs: list of Curve
# ---------- python_3: Python ----------
import os
import sys

sys.path.append(global_path)

from spacemapping_curve.quadtree import *
import spacemapping_curve.distance as sdf
import spacemapping_curve.hilbertcurve as hc

import Rhino.Geometry as rg
import rhinoscriptsyntax as rs 

reload(hc)
reload(sdf)

# ==============================================================================
# get distance value
# ==============================================================================
sdf.DistanceToCurve.GLOBAL_SCALE = GLOBAL_SCALE * 5
# sdf.FuckYouBernhardFunction.GLOBAL_SCALE = GLOBAL_SCALE

# sdf.SDF.X_SCALE = x
# sdf.SDF.Y_SCALE = y
# sdf.SDF.Z_SCALE = z

# sdf.FuckYouBernhardFunction.HEIGHT = height * z

crv_distance = sdf.DistanceToCurve(crvs)

pinch_d = sdf.PinchD(x, y, z, height, GLOBAL_SCALE, 10, -.5, 14)

gyroid = sdf.Gyroid(x, y, z, height, GLOBAL_SCALE * 10.0)

# structure = hc.BooleanUnion([crv_distance, pinch_d, gyroid])
structure = hc.BooleanUnion([pinch_d, gyroid])

# ==============================================================================
# Main
# ==============================================================================

a = hc.draw_hc(200, max_depth, structure)
# ---------- end python_3 ----------
python_4 = GhPythonScript(x=merge_2, y=merge, z=pt)  # -> out, a, b; inputs x: list, y: list, z: list of Point3d
# ---------- python_4: Python ----------
import Rhino.Geometry as rg

x_int = rg.Interval(x[0], x[1])
y_int = rg.Interval(y[0], y[1])

a = rg.Rectangle3d(rg.Plane.WorldXY, x_int, y_int)

b = []

for pt in z:

    if a.Contains(pt) == rg.PointContainment.Inside:
        
        b.append(pt)
# ---------- end python_4 ----------
panel_2 = Panel(python_4.out)
panel_3 = Panel(python_3.out)
end_start_gcode = GhPythonScript(x=python.path_gcode_lib, add_header=Toggle(True), lines=flatten(gcodelines.a))  # -> out, a; inputs add_header: Boolean, lines: list
# ---------- end_start_gcode: Python ----------
import os
import scriptcontext as sc

# creating the header of the gcode file

if add_header:
    key_list = sc.sticky["PrintSettings"].keys()
    key_list.sort()

    for key_item in key_list:
    
        print(";{} : {}".format(key_item, str(sc.sticky["PrintSettings"][key_item])) )

start_gcode_path = os.path.join(x, "GCodeDefinitions", "startGcode.txt")
end_gcode_path = os.path.join(x, "GCodeDefinitions", "endGcode.txt")

print(start_gcode_path)
print(end_gcode_path)

start_gcode = open(start_gcode_path, 'r').read()
end_gcode = open(end_gcode_path, 'r').read()

print start_gcode

for line in lines:

    print(line)

print end_gcode
# ---------- end end_start_gcode ----------
panel_4 = Panel(end_start_gcode.out)
savefile = Button()
python_5 = GhPythonScript(y=savefile, extra_name=Toggle(False), data=flatten(end_start_gcode.out))  # -> out, a; inputs data: list
# ---------- python_5: Python ----------
import os
import scriptcontext as sc
import math
import time
import scriptcontext as sc

import sys
sys.path.append(x)

import simpleStartStop as ss

reload(ss)

try:
    
    run_timing = time.time() - sc.sticky["start_time"]
    
    if run_timing > 2.0:
    
        sc.sticky["start_time"] = time.time()
        
        run = True
        
    else:
        
        run = False
    
except:
    
    sc.sticky["start_time"] = time.time()
    
    run = True

if y and run:

    count_file = os.path.join(x, "GCodeDefinitions", "countSheet.json")

    nozzle_dia = 0

    str = ss.file_count(nozzle_dia, count_file)

    date = time.strftime("%Y%m%d")

    if extra_name:
    
        file_name = "{}_{}_{}.gcode".format(str, date, extra_txt)
    
    else:
    
        file_name = "{}_{}.gcode".format(str, date)

    save_file = os.path.join(os.path.dirname(x), "TestRuns", file_name)

    print save_file

    data = '\n'.join(data)

    open(save_file, "a").write(data)
# ---------- end python_5 ----------
