# Grasshopper definition HilbertGcode_3.gh (Grasshopper 1.0.7)

number_slider = Slider(0, range=0..1000)
number_slider_2 = Slider(2.5, range=0..5)
number_slider_3 = Slider(1, range=0..10)
crv = Curve(<curve referenced from the Rhino model>)

# ---- group: don't remove
python = GhPythonScript()  # -> out, path_general, path_gcode_lib, path_gcode_files
# ---------- python: Python ----------
import os

print(os.name)
os_name = str(os.name)

ghComp = ghenv.Component
ghDoc = ghComp.OnPingDocument()

path = str(ghDoc.FilePath)

def degreed_parent(path, degree = 1):
    
    for i in range(degree):
        
        path = os.path.dirname(path)
        
    return path

parent = degreed_parent(path, 3)

if "posix" == os_name:
    
    print("I am a Mac")
    

elif "nt" == os_name:

    print("I am a Pc")

path_general = os.path.join(parent, "src", "spacemapping_curve")
path_gcode_lib = os.path.join(path_general,"gcode")
path_gcode_files = os.path.join(parent,"gcode")

print(path_general)
print(path_gcode_lib)
print(path_gcode_files)
# ---------- end python ----------
defaultmap = FilePath(python.path_general)
path = FilePath()
python_2 = GhPythonScript(default_dropbox_path=defaultmap, costum_path=path)  # -> out, path
# ---------- python_2: Python ----------
import sys
import scriptcontext as sc

if costum_path == None:
    path = default_dropbox_path
    
else:
    path = costum_path

sys.path.append(path)

sc.sticky["PrintSettings"] = {"library_path": path}
sc.sticky["PrintSettings"]["_project:"] = "hilbert_TPMS"
sc.sticky["PrintSettings"]["_project_by:"] = "WenqianYang, JonasWard"
sc.sticky["PrintSettings"]["_project_gcode_generator_by:"] = "JonasWard"
print(sys.path)
# ---------- end python_2 ----------

# ----
pt = ConstructPoint(XCoordinate=number_slider, YCoordinate=number_slider, ZCoordinate=0)
Z = UnitZ(Factor=Slider(0.5, range=0..1))
layers = GhPythonScript(start_height=Slider(1.4, range=0..5), layer_height=number_slider_2, layer_count=number_slider_3)  # -> out, height_list, layer_pts; inputs layer_count: Int32
# ---------- layers: Python ----------
import Rhino.Geometry as rg


height_list = []

for i in range(layer_count):
    
    height = start_height + layer_height * i
    
    height_list.append(height)
# ---------- end layers ----------
python_3 = GhPythonScript(crv=crv)  # -> out, a; inputs crv: Curve
# ---------- python_3: Python ----------
import sys
import rhinoscriptsyntax as rs

import Rhino.Geometry as rg

sys.path.append("/Users/jonas/Documents/reps/spacemapping_curve/src/spacemapping_curve/matplotlib_qt")

import quad_tree as qt

reload(qt)

global crv

def distance_to_crv(vec):
    
    v = rg.Point3d(vec.x, vec.y, vec.z)
    
    _, t_val = crv.ClosestPoint(v)
    pt_on_c = crv.PointAt(t_val)
    
    print(pt_on_c)
    
    return 5 - pt_on_c.DistanceTo(v) / 12.

# q_obj = qt.QuadObj(qt.distance_f)
q_obj = qt.QuadObj(distance_to_crv)
q_obj.create()
a = rs.AddPolyline(q_obj.tuple_list())
# ---------- end python_3 ----------
panel = Panel(python.out)
line = Line([Line((-10.70598199, 9.091782618, 0), (0.1530363311, -0.1549797077, 0)), Line((0.1530363311, -0.1075604137, 0), (24.90590779, 15.39854872, 0)), Line((0.05819774318, -0.1075604137, 0), (10.15732862, -33.60252886, 0))])
addition = Addition(A=pt, B=Z)
number_slider_4 = Slider(7.22, range=1..50)
number_slider_5 = Slider(15.87, range=1..50)
python_4 = GhPythonScript(lines=line, y=Slider(1.2, range=0..10))  # -> out, a; inputs lines: list of Line
# ---------- python_4: Python ----------
start_pts = [line.From for line in lines]
end_pts = [line.To for line in lines]

a = start_pts + end_pts
# ---------- end python_4 ----------
panel_2 = Panel(python_3.out)
merge = Merge(Data1=Slider(3.1, range=0..100), Data2=Slider(77.8, range=0..100))
merge_2 = Merge(Data1=Slider(13.5, range=0..100), Data2=Slider(89.9, range=0..100))
crv_2 = Curve(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)
pt_2 = Point([Point(120.2773554, 101.5225194, 0), Point(48.97591003, 86.30320507, 0), Point(77.53818492, 71.29237447, 0), Point(108.3937812, 31.26349286, 0), Point(61.27645177, 27.92775273, 0), Point(61.48493553, -10.85022633, 0)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])
python_5 = GhPythonScript(
    global_path=python.path_general,
    crvs=crv_2,
    GLOBAL_SCALE=Slider(0.3, range=0.2..100),
    max_depth=Slider(5, range=0..10),
    x=number_slider_4,
    y=number_slider_4,
    z=Slider(2.96, range=1..10),
    height=layers.height_list,
    base_height=Slider(2.9, range=1..10))  # -> out, flatten(a); inputs crvs: list of Curve
# ---------- python_5: Python ----------
import os
import sys

sys.path.append(global_path)

from quadtree import *
import distance as sdf
import hilbertcurve as hc

import Rhino.Geometry as rg
import rhinoscriptsyntax as rs 

reload(hc)
reload(sdf)

height += base_height

# ==============================================================================
# get distance value
# ==============================================================================
sdf.DistanceToCurve.GLOBAL_SCALE = GLOBAL_SCALE * 5
# sdf.FuckYouBernhardFunction.GLOBAL_SCALE = GLOBAL_SCALE

# sdf.SDF.X_SCALE = x
# sdf.SDF.Y_SCALE = y
# sdf.SDF.Z_SCALE = z

# sdf.FuckYouBernhardFunction.HEIGHT = height * z

crv_distance = sdf.DistanceToCurve(crvs)

# pinch_d = sdf.PinchD(x, y, z, height, GLOBAL_SCALE, 10, -.5, 14)

gyroid = sdf.Gyroid(x, y, z, height, GLOBAL_SCALE * 10.0)

# structure = hc.BooleanUnion([crv_distance, pinch_d, gyroid])
# structure = hc.BooleanUnion([pinch_d, gyroid])

# ==============================================================================
# Main
# ==============================================================================

a = [hc.draw_hc_b(200, max_depth, crv_distance, return_pts = True)]
# ---------- end python_5 ----------
layers_2 = GhPythonScript(pt_lists=python_5.a, height_list=layers.height_list, layer_height=number_slider_2, layer_count=number_slider_3)  # -> out, height_list, layer_pts; inputs pt_lists: list, height_list: list, layer_count: Int32
# ---------- layers_2: Python ----------
import Rhino.Geometry as rg

layer_pts = []

for i, pts in enumerate(pt_lists):
        
    if i % 2 == 1:
        
        pts.reverse()
    
    height = height_list[i]
    
    mv_pt = rg.Point3d(0, 0, height)
    
    for pt in pts:
        
        layer_pts.append(mv_pt + rg.Point3d(pt[0], pt[1], pt[2]))
# ---------- end layers_2 ----------
gcodelines = GhPythonScript(
    x=python.path_gcode_lib,
    pts=layers_2.layer_pts,
    feed_rate=Slider(25, range=0..100),
    extrusion_rate=Slider(0.8, range=0..1),
    variable_feed_rate=Toggle(False))  # -> out, a, path_vis; inputs pts: list, variable_feed_rate: Boolean
# ---------- gcodelines: Python ----------
import sys

sys.path.append(x)

import Rhino.Geometry as rg
import simpleStartStop as ss

reload(ss)

# print(pts)

p_set = ss.PrintSettings(
    feed_rate = feed_rate, 
    extrusion_rate = extrusion_rate, 
    extrusion_mode = 'relative', 
    movement_mode = 'relative'
)

if variable_feed_rate:
    
    p_set.setComplexFeedrate(
        peak_feed_rate,
        min_h_ramp = (start_min, start_max),
        max_h_ramp = (end_max, end_min)
    )

l_type = ss.LinkType(
    link_type = link_type,
    global_trim_distance = 0.0,
    ss_trim_distance = 0.0,
    cull_distance = 0.0,
    lift_val = 0.0
)

l_type.ss_f_rate = ss_f_rate
l_type.ss_e_rate = ss_e_rate

gcodeset = ss.GCodeSet(pts, p_set, l_type)
a = gcodeset.generateGCode()

path_vis = gcodeset.path_vis
# ---------- end gcodelines ----------
panel_3 = Panel(layers_2.out)
python_6 = GhPythonScript(x=merge_2, y=merge, z=pt_2)  # -> out, a, b; inputs x: list, y: list, z: list of Point3d
# ---------- python_6: Python ----------
import Rhino.Geometry as rg

x_int = rg.Interval(x[0], x[1])
y_int = rg.Interval(y[0], y[1])

a = rg.Rectangle3d(rg.Plane.WorldXY, x_int, y_int)

b = []

for pt in z:

    if a.Contains(pt) == rg.PointContainment.Inside:
        
        b.append(pt)
# ---------- end python_6 ----------
pline = PolyLine(Vertices=layers_2.layer_pts, Closed=False)
panel_4 = Panel(python_6.out)
len = Length(Curve=pline)
panel_5 = Panel(python_5.out)
end_start_gcode = GhPythonScript(x=python.path_gcode_lib, add_header=Toggle(True), lines=flatten(gcodelines.a))  # -> out, a; inputs add_header: Boolean, lines: list
# ---------- end_start_gcode: Python ----------
import os
import scriptcontext as sc

# creating the header of the gcode file

if add_header:
    key_list = sc.sticky["PrintSettings"].keys()
    key_list.sort()

    for key_item in key_list:
    
        print(";{} : {}".format(key_item, str(sc.sticky["PrintSettings"][key_item])) )

start_gcode_path = os.path.join(x, "GCodeDefinitions", "startGcode.txt")
end_gcode_path = os.path.join(x, "GCodeDefinitions", "endGcode.txt")

print(start_gcode_path)
print(end_gcode_path)

start_gcode = open(start_gcode_path, 'r').read()
end_gcode = open(end_gcode_path, 'r').read()

print start_gcode

for line in lines:

    print(line)

print end_gcode
# ---------- end end_start_gcode ----------
panel_6 = Panel(end_start_gcode.out)
savefile = Button()
python_7 = GhPythonScript(
    y=savefile,
    x=python.path_gcode_lib,
    folder_path=python.path_gcode_files,
    extra_name=Toggle(True),
    extra_txt="TryMe",
    data=flatten(end_start_gcode.out))  # -> out, a; inputs data: list
# ---------- python_7: Python ----------
import os
import scriptcontext as sc
import math
import time
import scriptcontext as sc

import sys
sys.path.append(x)

import simpleStartStop as ss

reload(ss)

try:
    
    run_timing = time.time() - sc.sticky["start_time"]
    
    if run_timing > 2.0:
    
        sc.sticky["start_time"] = time.time()
        
        run = True
        
    else:
        
        run = False
    
except:
    
    sc.sticky["start_time"] = time.time()
    
    run = True

if y and run:

    count_file = os.path.join(x, "GCodeDefinitions", "countSheet.json")

    nozzle_dia = 0.0

    str = ss.file_count(nozzle_dia, count_file)

    date = time.strftime("%Y%m%d")

    if extra_name:
    
        file_name = "{}_{}_{}.gcode".format(str, date, extra_txt)
    
    else:
    
        file_name = "{}_{}.gcode".format(str, date)

    save_file = os.path.join(folder_path, file_name)

    print save_file

    data = '\n'.join(data)

    open(save_file, "a").write(data)
    
    save_file.close()
# ---------- end python_7 ----------
panel_7 = Panel(python_7.out)
