# Grasshopper definition RD_Clay.gh (Grasshopper 1.0.7)
# plug-ins: MeshEdit Components, Pufferfish, Weaverbird

# ---- group: Exemple with loxodrome
# Loxodrome with variable radius
number_of_points_per_turn = Slider(24, range=10..150)
beta = Slider(51.0117, range=0.2..89.2)
number_of_turns = Slider(6, range=0..20)
radius = Slider(1, range=0.2..20)

# ---- group: SpiralInfill
crv = Curve(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)
divide = DivideCurve(Curve=crv, Count=Slider(25, range=0..100), Kinks=False)  # -> Points, Tangents, Parameters
ma = MassAddition(Input=divide.Points)  # -> Result, PartialResults
lng = ListLength(List=divide.Points)
division = Division(A=ma.Result, B=lng)
dist = Distance(PointA=divide.Points, PointB=division)
sort = SortList(Keys=dist)  # -> Keys, ValuesA
layerwidth = Number(Slider(4, range=0..10))
item = ListItem(List=sort.Keys, Index=0, Wrap=True)  # -> Item1, Item
division_2 = Division(A=item.Item1, B=layerwidth)
circle = CircleCNR(Center=division, Normal=Vector(0, 0, 1), Radius=item.Item1)
ln = Line(StartPoint=division, EndPoint=divide.Points)
round = Round(Number=division_2)  # -> Nearest, Floor, Ceiling
python = GhPythonScript(lines=ln, count=round.Ceiling)  # -> out, pts; inputs lines: list of Line, count: Int32
# ---------- python: Python ----------
import Rhino.Geometry as rg

pt_set = [[] for i in range(count + 1)]

f_count = float(count)
delta = 1.0 / float(f_count)

for line_idx, line in enumerate(lines):
    
    extra_val = line_idx * delta
    
    for i in range(count):
        
        pt = line.PointAt( (i + extra_val) / f_count )
        
        pt_set[i].append(pt)
    
pts = []

[pts.extend(loc_pts) for loc_pts in pt_set]
# ---------- end python ----------
division_3 = Division(A=item.Item1, B=round.Ceiling)
rev = ReverseList(List=python.pts)
series = Series(Start=division_3, Step=division_3, Count=round.Ceiling)
circle_2 = CircleCNR(Center=division, Normal=Vector(0, 0, 1), Radius=series)
pline = PolyLine(Vertices=rev, Closed=False)
panel = Panel(python.out)
eval = EvaluateCurve(Curve=pline, Parameter=Slider(100, range=0..100))  # -> Point, Tangent, Angle

# ---- group: VariatingHeight
number_slider = Slider(40, range=0..100)
pt = Point(Point(-41.41980249, -41.79623016, 0))
crv_2 = Curve(<curve referenced from the Rhino model>)
crv_3 = Curve(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)
pt_2 = Point(Point(24.28787599, 22.45567797, 0))
divide_2 = DivideCurve(Curve=crv_2, Count=number_slider, Kinks=False)  # -> Points, Tangents, Parameters
remap = RemapNumbers(Source=Domain(0, 1), Target=Domain(0, 1))  # -> Mapped, Clipped
merge = Merge(Data1=Slider(0.85, range=0..10), Data2=Slider(1.15, range=0..10))
ln_2 = Line(StartPoint=pt_2, EndPoint=pt)
series_2 = Series(Start=0, Step=Slider(2.5, range=0..10), Count=Slider(30, range=0..100))
Z = UnitZ(Factor=series_2)  # -> graft(UnitVector)
move = Move(Geometry=divide_2.Points, Motion=Z)  # -> flatten(Geometry), Transform
python_2 = GhPythonScript(line=ln_2, pts=move.Geometry, domain_remap=merge, pt_count=number_slider, sinoid=Toggle(True))  # -> out, new_pts; inputs line: Line, pts: list of Point3d, domain_remap: list, sinoid: Boolean
# ---------- python_2: Python ----------
import Rhino.Geometry as rg
import math
# import ghpythonlib as gh

new_pts = []

z_scale_delta = domain_remap[1] - domain_remap[0]
base = domain_remap[0]

periods = 3.0

for pt_idx, pt in enumerate(pts):
    
    if sinoid:
        
        angle = pt_idx / pt_count * periods * math.pi * 2.0
        
        z_scale_raw = (math.sin(angle) + 1.0) * .5
        
    else:
        
        z_scale_raw = line.ClosestParameter(pt)
        
    z_scale_val = z_scale_raw * z_scale_delta + base
    
    new_pts.append( rg.Point3d(pt.X, pt.Y, pt.Z * z_scale_val) )
# ---------- end python_2 ----------
remap_2 = RemapNumbers(Source=Domain(0, 1), Target=Domain(0, 1))  # -> Mapped, Clipped
pline_2 = PolyLine(Vertices=python_2.new_pts, Closed=False)

# ---- group: Exemple with loxodrome / SLOPE
eval_2 = Evaluate(F="1/tan(beta*pi/180)", beta=beta)

# ----
crv_4 = Curve([<curve referenced from the Rhino model> x2])
crv_5 = Curve([<curve referenced from the Rhino model> x5])
crv_6 = Curve([<curve referenced from the Rhino model> x4])
crv_7 = Curve([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])
loft = Loft(Curves=crv_6, Options={Adjust=True, Closed=False, LoftEnds=0, LoftSimp=0, LoftType=0, Rebuild=10, Refit=0.01})
srf = Surface(<surface referenced from the Rhino model>)

# ---- group: Exemple with loxodrome
eval_3 = Evaluate(F="-pi*n", n=number_of_turns)
multiplication = Multiplication(A=number_of_turns, B=number_of_points_per_turn)
division_4 = Division(A="2*pi", B=number_of_points_per_turn)
series_3 = Series(Start=eval_3, Step=division_4, Count=multiplication)

# ---- group: Exemple with loxodrome / X, Y and Z
eval_4 = Evaluate(F="radius*sin(lambda)/cosh(m*lambda)", radius=radius, m=eval_2, lambda=series_3)
eval_5 = Evaluate(F="radius*tanh(m*lambda)", radius=radius, m=eval_2, lambda=series_3)
eval_6 = Evaluate(F="radius*cos(lambda)/cosh(m*lambda)", radius=radius, m=eval_2, lambda=series_3)

# ----
python_3 = GhPythonScript(brep_srf=loft, u_res=Slider(30, range=2..50), v_res=Slider(12, range=2..25), transpose=Toggle(True), quad=Toggle(True))  # -> out, pts, mesh_version, a; inputs brep_srf: Surface, u_res: Int32, v_res: Int32, transpose: Boolean
# ---------- python_3: Python ----------
import Rhino.Geometry as rg

u_interval = rg.Interval(0, u_res)
v_interval = rg.Interval(0, v_res)

brep_srf.Transpose(transpose)

brep_srf.SetDomain(0, u_interval)
brep_srf.SetDomain(1, v_interval)

pts = []

mesh_version = rg.Mesh()

for v in range(v_res + 1):
    
    for u in range(u_res):
        
        loc_u = u + (v % 2 == 1) * .5
            
        _, pt, _ = brep_srf.Evaluate(loc_u, v, 0)
        
        pts.append(pt)
        mesh_version.Vertices.Add(pt.X, pt.Y, pt.Z)

# print("u_res: {}, v_res: {}".format(u_res, v_res) )

# print("v layer count: {}".format(len([i for i in range(v_res + 1)]) ) )
# print("vertex count: {}".format(len(mesh_version.Vertices) ) )
        
for y_i in range(v_res):
    
    y_0 = y_i * (u_res)
    y_1 = (y_i + 1) * (u_res)
    
    print("\ty_0: {}, y_1: {}".format(y_0, y_1) )
    
    for x_i in range(u_res):
        
        a = y_0 + x_i
        b = y_0 + (x_i + 1) % u_res
        c = y_1 + (x_i + 1) % u_res
        d = y_1 + x_i
        
        if quad:
        
            mesh_version.Faces.AddFace(a, b, c, d)
            
        else:
            
            if y_i % 2 == 0:
                
                mesh_version.Faces.AddFace(d, a, b)
                mesh_version.Faces.AddFace(d, b, c)
            
            else:
                mesh_version.Faces.AddFace(d, a, c)
                mesh_version.Faces.AddFace(a, b, c)
# ---------- end python_3 ----------
mesh = Mesh(python_3.mesh_version)

# ---- group: Exemple sphere
wbicosahedron = WeaverbirdsMeshMeshIcosahedron(Plane=PlaneXY(0, 0, 0), Radius=5)
wbtriangles = WeaverbirdsSplitTrianglesSubdivision(MeshCurves=wbicosahedron, Level="25")
pt_3 = ConstructPoint(XCoordinate=0, YCoordinate=0, ZCoordinate=0)
demesh = DeconstructMesh(Mesh=wbtriangles)  # -> Vertices, Faces, Colours, Normals
dist_2 = Distance(PointA=pt_3, PointB=demesh.Vertices)
division_5 = Division(A=demesh.Vertices, B=dist_2)
conmesh = ConstructMesh(Vertices=division_5, Faces=demesh.Faces)
weldvertices = MeshWeldVertices(Mesh=conmesh, Tolerance=0.01)  # -> RuntimeMessage, Mesh

# ----
pt_4 = Point(python_3.pts)
number_slider_2 = Slider(150, range=0..1000)
number_slider_3 = Slider(150, range=0..1000)
number_slider_4 = Slider(10, range=0..10)
number_slider_5 = Slider(150, range=0..1000)
number_slider_6 = Slider(150, range=0..1000)
number_slider_7 = Slider(10, range=0..10)
panel_2 = Panel(python_3.out)
python_4 = GhPythonScript(length=number_slider_5, width=number_slider_6, radius=number_slider_7)  # -> out, a
# ---------- python_4: Python ----------
import Rhino.Geometry as rg

x_count, y_count = int(length / radius), int(width / radius)
x_step, y_step = length / (x_count), width / (y_count)

x_vals = [x_step * i for i in range(x_count + 1)]
y_vals = [y_step * i for i in range(y_count + 1)]

pts = []

for y in y_vals:
    
    for x in x_vals:
        
        pts.append(rg.Point3d(x, y, 0))

a = pts
# ---------- end python_4 ----------
python_5 = GhPythonScript(length=number_slider_5, width=number_slider_6, radius=number_slider_7, quad=Toggle(False))  # -> out, a; inputs quad: Boolean
# ---------- python_5: Python ----------
import Rhino.Geometry as rg

x_count, y_count = int(length / radius), int(width / radius)
x_step, y_step = length / (x_count), width / (y_count)

x_vals = [x_step * i for i in range(x_count + 1)]
y_vals = [y_step * i for i in range(y_count + 1)]

pts = []

a = rg.Mesh()

for y in y_vals:
    
    for x in x_vals:
        
        a.Vertices.Add(x, y, 0)

for y_i in range(y_count):
    
    y_0 = y_i * (y_count + 1)
    y_1 = (y_i + 1) * (y_count + 1)
    
    for x_i in range(x_count):
        
        if quad:
        
            a.Faces.AddFace(
                y_0 + x_i,
                y_0 + x_i + 1,
                y_1 + x_i + 1,
                y_1 + x_i
            )
            
        else:
            
            a.Faces.AddFace(
                y_0 + x_i,
                y_0 + x_i + 1,
                y_1 + x_i
            )
            
            a.Faces.AddFace(
                y_0 + x_i + 1,
                y_1 + x_i + 1,
                y_1 + x_i
            )
# ---------- end python_5 ----------

# ---- group: Exemple with loxodrome
# Laurent Delrieu
# 19/05/2013
# 
# Based on definition of Loxodrome on
# http://en.wikipedia.org/wiki/Rhumb_line
pt_5 = ConstructPoint(XCoordinate=eval_6, YCoordinate=eval_4, ZCoordinate=eval_5)
intcrv = Interpolate(Vertices=pt_5, Degree=3, Periodic=False, KnotStyle=1)  # -> Curve, Length, Domain
range = Range(Domain="0 to 2*pi", Steps=Slider(7, range=1..20))
rotate = Rotate(Geometry=intcrv.Curve, Angle=range, Plane=PlaneXY(0, 0, 0))  # -> Geometry, Transform

# ----
wbedges = WeaverbirdsMeshEdges(MeshOrPolylines=python_3.mesh_version)
number_slider_8 = Slider(0, range=0..1000)
pt_6 = Point(python_2.new_pts)
pt_7 = Point(divide_2.Points)
number_slider_9 = Slider(1, range=0..10)
number_slider_10 = Slider(2.5, range=0..5)

# ---- group: Mesh (triangular is best)
mesh_2 = Mesh(mesh)

# ----
diffusion_b = Panel("0.25")
crv_8 = Curve(rotate.Geometry)
kill = Panel("0.062")
dir_factor_0_1_to_5 = Panel("2")
feed = Panel("0.0545")
rev_2 = ReverseList(List=python.pts)
mesh_displacement = Slider(3, range=-5..5)
item_2 = ListItem(List=pt_7, Index=0, Wrap=True)
pt_8 = ConstructPoint(XCoordinate=number_slider_8, YCoordinate=number_slider_8, ZCoordinate=0)
Z_2 = UnitZ(Factor=Slider(0.5, range=0..1))
wbloop = WeaverbirdsLoopSubdivision(MeshCurves=mesh_2, Level="3", SmoothNakedEdges=1)
demesh_2 = DeconstructMesh(Mesh=wbloop)  # -> Vertices, Faces, Colours, Normals

# ---- group: don't remove
python_6 = GhPythonScript()  # -> out, path_general, path_gcode_lib, path_gcode_files
# ---------- python_6: Python ----------
import os

print(os.name)
os_name = str(os.name)

ghComp = ghenv.Component
ghDoc = ghComp.OnPingDocument()

path = str(ghDoc.FilePath)

def degreed_parent(path, degree = 1):
    
    for i in range(degree):
        
        path = os.path.dirname(path)
        
    return path

parent = degreed_parent(path, 3)

if "posix" == os_name:
    
    print("I am a Mac")
    

elif "nt" == os_name:

    print("I am a Pc")

path_general = os.path.join(parent, "src", "spacemapping_curve")
path_gcode_lib = os.path.join(path_general,"gcode")
path_gcode_files = os.path.join(parent,"gcode")

print(path_general)
print(path_gcode_lib)
print(path_gcode_files)
# ---------- end python_6 ----------
defaultmap = FilePath(python_6.path_general)
path = FilePath()
python_7 = GhPythonScript(default_dropbox_path=defaultmap, costum_path=path)  # -> out, path
# ---------- python_7: Python ----------
import sys
import scriptcontext as sc

if costum_path == None:
    path = default_dropbox_path
    
else:
    path = costum_path

sys.path.append(path)

sc.sticky["PrintSettings"] = {"library_path": path}
sc.sticky["PrintSettings"]["_project:"] = "hilbert_TPMS"
sc.sticky["PrintSettings"]["_project_by:"] = "WenqianYang, JonasWard"
sc.sticky["PrintSettings"]["_project_gcode_generator_by:"] = "JonasWard"
print(sys.path)
# ---------- end python_7 ----------

# ----
pt_9 = Point(rev_2)
layers = GhPythonScript(start_height=Slider(1.4, range=0..5), layer_height=number_slider_10, layer_count=number_slider_9)  # -> out, height_list, layer_pts; inputs layer_count: Int32
# ---------- layers: Python ----------
import Rhino.Geometry as rg


height_list = []

for i in range(layer_count):
    
    height = start_height + layer_height * i
    
    height_list.append(height)
# ---------- end layers ----------
layers_2 = GhPythonScript(height_list=layers.height_list, layer_height=number_slider_10, layer_count=number_slider_9)  # -> out, height_list, layer_pts; inputs pt_lists: list, height_list: list, layer_count: Int32
# ---------- layers_2: Python ----------
import Rhino.Geometry as rg

layer_pts = []

for i, pts in enumerate(pt_lists):
        
    if i % 2 == 1:
        
        pts.reverse()
    
    height = height_list[i]
    
    mv_pt = rg.Point3d(0, 0, height)
    
    for pt in pts:
        
        layer_pts.append(mv_pt + pt)
# ---------- end layers_2 ----------
addition = Addition(A=pt_8, B=Z_2)
bbox = BoundingBox(Content=wbloop, Plane=PlaneXY(0, 0, 0))  # -> Box, Box_2

# ---- group: Calulate tangents on vertices and distance from curves
c_script = CSharpScript(Mesh=wbloop, Curves=crv_8)  # -> out, tangents, distances; inputs Mesh: Mesh, Curves: list of Curve
# ---------- c_script: C# ----------
    //Developped by Laurent Delrieu
    //Used to calculate direction on Vectex of a Mesh
    int size = _Mesh.Vertices.Count;
    Vector3d[] tangents = new Vector3d[size];
    double[] distances = new double[size];
    for (int i = 0; i < size; ++i) tangents[i] = new Vector3d();


    System.Threading.Tasks.Parallel.For(0, size, i => getTangent(i, _Mesh, _Curves, ref tangents, ref distances));
    _tangents = tangents.ToList();
    _distances = distances.ToList();
# ---------- c_script: C# additional code ----------
  static void getTangent(int i, Mesh _Mesh, List<Curve> _Curves, ref Vector3d[] tangents, ref double[] distances)
  {
    double distTampon = Double.MaxValue;
    double dist;
    double t;
    Vector3d vect = new Vector3d(1, 0, 0);

    if (_Curves[0].ClosestPoint(_Mesh.Vertices[i], out t))
    {
      distTampon = new Point3d(_Mesh.Vertices[i]).DistanceTo(_Curves[0].PointAt(t));
      vect = _Curves[0].TangentAt(t);
    }
    for (int j = 1;j < _Curves.Count; j++)
    {
      if (_Curves[j].ClosestPoint(_Mesh.Vertices[i], out t))
      {
        dist = new Point3d(_Mesh.Vertices[i]).DistanceTo(_Curves[j].PointAt(t));
        if (dist < distTampon)
        {
          distTampon = dist;
          vect = _Curves[j].TangentAt(t);
        }
      }
    }
    tangents[i] = Vector3d.CrossProduct(Vector3d.CrossProduct(vect, new Vector3d(_Mesh.Normals[i])), new Vector3d(_Mesh.Normals[i]));
    if (tangents[i].Length == 0.0) tangents[i].X = 1.0;
    distances[i] = distTampon;
  }
# ---------- end c_script ----------

# ---- group: Brim
item_3 = ListItem(Index=0, Wrap=True)
divide_3 = DivideCurve(Curve=item_3, Count=1, Kinks=True)  # -> Points, Tangents, Parameters
brim = GhPythonScript(
    x=python_6.path_gcode_lib,
    first_pt=item_2,
    pts=pt_7,
    offset_amount=Slider(10, range=-10..10),
    start_safety_distance=Slider(50, range=10..100))  # -> out, flatten(a), start_pt, outer_brim_crv, base_pt, crv; inputs first_pt: Point3d, pts: list of Point3d
# ---------- brim: Python ----------
import sys

sys.path.append(x)

import Rhino.Geometry as rg
import generalFunctions as gf
import polyline as pl

reload(pl)

crv = rg.Polyline(pts).ToPolylineCurve()
_, t_val = crv.ClosestPoint(first_pt)

print(t_val)

crv.ChangeClosedCurveSeam(t_val)

base_pt_set = list(crv.ToPolyline().ToArray())

brim_pl = pl.StructuredPolyline(base_pt_set[:-1])
brim_pl.offset(offset_amount)

pt_set = brim_pl.pointSet() + [brim_pl.pointSet()[0]]

crv = rg.Polyline(pt_set).ToPolylineCurve()
_, t_val = crv.ClosestPoint(first_pt)

base_pt = crv.PointAt(t_val)
crv.ChangeClosedCurveSeam(t_val)

# base_pt = brim_pl.v_set[0]
start_pt, first_pt = base_pt, first_pt

start_pt = first_pt + (start_pt - first_pt) * (start_safety_distance / offset_amount)

# a = [rg.Point3d(start_pt)] + brim_pt_set
a = list(crv.ToPolyline().ToArray())
# ---------- end brim ----------

# ----
panel_3 = Panel(python_6.out)
line = Line([Line((-10.70598199, 9.091782618, 0), (0.1530363311, -0.1549797077, 0)), Line((0.1530363311, -0.1075604137, 0), (24.90590779, 15.39854872, 0)), Line((0.05819774318, -0.1075604137, 0), (10.15732862, -33.60252886, 0))])
pt_10 = Point(brim.a)
panel_4 = Panel(layers_2.out)
python_8 = GhPythonScript(lines=line, y=Slider(1.2, range=0..10))  # -> out, a; inputs lines: list of Line
# ---------- python_8: Python ----------
start_pts = [line.From for line in lines]
end_pts = [line.To for line in lines]

a = start_pts + end_pts
# ---------- end python_8 ----------
merge_2 = Merge(Data1=pt_10, Data2=flatten(pt_6))  # -> flatten(Result)
ma_2 = MassAddition(Input=pt_10)  # -> Result, PartialResults
lng_2 = ListLength(List=pt_10)
gcodelines = GhPythonScript(
    x=python_6.path_gcode_lib,
    pts=merge_2,
    feed_rate=Slider(25, range=0..100),
    extrusion_rate=Slider(0.8, range=0..1),
    variable_feed_rate=Toggle(False))  # -> out, a, path_vis; inputs pts: list of Point3d, variable_feed_rate: Boolean
# ---------- gcodelines: Python ----------
import sys

sys.path.append(x)

import Rhino.Geometry as rg
import simpleStartStop as ss

reload(ss)

# print(pts)

p_set = ss.PrintSettings(
    feed_rate = feed_rate, 
    extrusion_rate = extrusion_rate, 
    extrusion_mode = 'relative', 
    movement_mode = 'relative'
)

if variable_feed_rate:
    
    p_set.setComplexFeedrate(
        peak_feed_rate,
        min_h_ramp = (start_min, start_max),
        max_h_ramp = (end_max, end_min)
    )

l_type = ss.LinkType(
    link_type = link_type,
    global_trim_distance = 0.0,
    ss_trim_distance = 0.0,
    cull_distance = 0.0,
    lift_val = 0.0
)

l_type.ss_f_rate = ss_f_rate
l_type.ss_e_rate = ss_e_rate

gcodeset = ss.GCodeSet(pts, p_set, l_type)
a = gcodeset.generateGCode()

p_set = ss.PrintSettings(
    feed_rate = feed_rate, 
    extrusion_rate = -100, 
    extrusion_mode = 'relative', 
    movement_mode = 'relative'
)

print(pts[-1])
print(end_pt)

# end_pt_bis = end_pt + rg.Point3d(0,0,20)

# a += ss.GCodeSet([pts[-1], end_pt, end_pt_bis], p_set, l_type).generateGCode()

path_vis = gcodeset.path_vis
# ---------- end gcodelines ----------
division_6 = Division(A=ma_2.Result, B=lng_2)
boxprop = BoxProperties(Box=bbox.Box)  # -> Center, Diagonal, Area, Volume, Degeneracy
c_script_2 = CSharpScript(M=wbloop, tangents=demesh_2.Normals, dB=diffusion_b, feed=feed, kill=kill, I="500", F=dir_factor_0_1_to_5)  # -> out, A, B; inputs M: Mesh, tangents: list of Vector3d, dB: Double, feed: Double, kill: Double, I: Int32, F: Double
# ---------- c_script_2: C# ----------
    //Developped by Vicente Soler and changed by Laurent Delrieu
    //http://www.grasshopper3d.com/forum/topics/reaction-diffusion-on-triangular-mesh
    //29th of August 2015

    var reaction = new ReactionDiffusion(1, dB, tangents, F, M, feed, kill);
    reaction.Run(I);

    A = reaction.listA;
    B = reaction.listB;
# ---------- c_script_2: C# additional code ----------
  class ReactionDiffusion
  {
    Random random = new Random(2);
    double da, db;
    double dirFactor;
    protected List<Particle> particles = new List<Particle>();

    public List<GH_Number> listA {get {return particles.Select(particle => new GH_Number(particle.A)).ToList();}}
    public List<GH_Number> listB {get {return particles.Select(particle => new GH_Number(particle.B)).ToList();}}

    public ReactionDiffusion(double da, double db, List<Vector3d> tangents, double dirFactor, Mesh mesh, double feed, double kill)
    {
      this.da = da;
      this.db = db;
      this.dirFactor = dirFactor;

      int size = mesh.Vertices.Count;
      for(int i = 0;i < size;i++)
      {
        double a = 1;
        double b = (random.NextDouble() < 0.05) ? 1 : 0;
        double f = feed;
        double k = kill;
        particles.Add(new Particle(a, b, f, k, mesh.Vertices[i], this));
      }

      System.Threading.Tasks.Parallel.For(0, size, i => particles[i].SetNeighbours(i, mesh, tangents[i]));
    }

    public void Run(int iterations)
    {
      while(iterations-- > 0)
      {
        System.Threading.Tasks.Parallel.ForEach(particles, particle => particle.Laplacian());
        System.Threading.Tasks.Parallel.ForEach(particles, particle => particle.ReactionDiffusion());
      }
    }

    protected class Particle
    {
      public double A {get; set;}
      public double B {get; set;}
      Point3d point;
      double dxA, dxB;
      double f, k;
      List<Particle> neighbours = new List<Particle>();
      List<double> weights = new List<double>();
      double weightTotal;
      ReactionDiffusion simulation;

      public Particle(double A, double B, double f, double k, Point3d point, ReactionDiffusion simulation)
      {
        this.A = A;
        this.B = B;
        this.f = f;
        this.k = k;
        this.point = point;
        this.simulation = simulation;
      }

      public void SetNeighbours(int i, Mesh mesh, Vector3d tangent)
      {
        foreach(int j in mesh.Vertices.GetConnectedVertices(i).Where(x => x != i))
        {
          neighbours.Add(simulation.particles[j]);

          double angle = Vector3d.VectorAngle(simulation.particles[j].point - point, tangent);
          double t = simulation.dirFactor;
          double weight = Math.Sqrt(Math.Sin(angle) * Math.Sin(angle) + t * t * Math.Cos(angle) * Math.Cos(angle));
          weights.Add(weight);
          weightTotal += weight;
        }
      }

      public void Laplacian()
      {
        double nA=0, nB = 0;
        for(int i = 0;i < neighbours.Count;i++)
        {
          nA += neighbours[i].A;
          nB += neighbours[i].B * weights[i];
        }
        nA /= neighbours.Count;
        nB /= weightTotal;

        dxA = nA - A;
        dxB = nB - B;
      }

      public void ReactionDiffusion()
      {
        double AB2 = A * B * B;
        A += simulation.da * dxA - AB2 + f * (1 - A);
        B += simulation.db * dxB + AB2 - (k + f) * B;

        A = Constrain(A);
        B = Constrain(B);
      }
    }

    static double Constrain(double val)
    {
      if (val < 0) return 0;
      else if(val > 1) return 1;
      return val;
    }
  }
# ---------- end c_script_2 ----------

# ---- group: Old version of tangents on vertices with components not C
cluster = Cluster()

# ----
pdecon = Deconstruct(Point=division_6)  # -> XComponent, YComponent, ZComponent
pt_11 = ConstructPoint(XCoordinate=0, YCoordinate=0, ZCoordinate=0)
panel_5 = Panel(gcodelines.out)
pline_3 = PolyLine(Vertices=merge_2, Closed=False)
dist_3 = Distance(PointA=pt_11, PointB=boxprop.Diagonal)
bnd = Bounds(Numbers=c_script_2.A)
crv_9 = Curve(brim.crv)
# Reaction diffusion on a mesh
# mainly based on
# http://www.karlsims.com/rd.html
# for the algorithm
# and
# http://n-e-r-v-o-u-s.com/
# for design
# 
# Recoded by Vicente Soler (parallelisation, objects) and Laurent Delrieu
# September 2015
remap_3 = RemapNumbers(Value=c_script_2.A, Source=bnd, Target=Domain(0, 1))  # -> Mapped, Clipped
expression = Expression(x=mesh_displacement, d=dist_3, Expression="(x/100)*d")
end_start_gcode = GhPythonScript(x=python_6.path_gcode_lib, add_header=Toggle(True), lines=flatten(gcodelines.a))  # -> out, a; inputs add_header: Boolean, lines: list
# ---------- end_start_gcode: Python ----------
import os
import scriptcontext as sc

# creating the header of the gcode file

if add_header:
    key_list = sc.sticky["PrintSettings"].keys()
    key_list.sort()

    for key_item in key_list:
    
        print(";{} : {}".format(key_item, str(sc.sticky["PrintSettings"][key_item])) )

start_gcode_path = os.path.join(x, "GCodeDefinitions", "startGcode.txt")
end_gcode_path = os.path.join(x, "GCodeDefinitions", "endGcode.txt")

print(start_gcode_path)
print(end_gcode_path)

start_gcode = open(start_gcode_path, 'r').read()
end_gcode = open(end_gcode_path, 'r').read()

print start_gcode

for line in lines:

    print(line)

print end_gcode
# ---------- end end_start_gcode ----------
gradient = Gradient(LowerLimit=0, UpperLimit=1, Parameter=remap_3.Clipped, stops=[0: RGB(255, 255, 255), 1: RGB(0, 0, 0)])
demesh_3 = DeconstructMesh(Mesh=wbloop)  # -> Vertices, Faces, Colours, Normals
multiplication_2 = Multiplication(A=expression, B=remap_3.Clipped)
multiplication_3 = Multiplication(A=demesh_3.Normals, B=multiplication_2)
savefile = Button()
python_9 = GhPythonScript(
    y=savefile,
    x=python_6.path_gcode_lib,
    folder_path=python_6.path_gcode_files,
    extra_name=Toggle(True),
    extra_txt="TryMe",
    data=flatten(end_start_gcode.out))  # -> out, a; inputs data: list
# ---------- python_9: Python ----------
import os
import scriptcontext as sc
import math
import time
import scriptcontext as sc

import sys
sys.path.append(x)

import simpleStartStop as ss

reload(ss)

try:
    
    run_timing = time.time() - sc.sticky["start_time"]
    
    if run_timing > 2.0:
    
        sc.sticky["start_time"] = time.time()
        
        run = True
        
    else:
        
        run = False
    
except:
    
    sc.sticky["start_time"] = time.time()
    
    run = True

if y and run:

    count_file = os.path.join(x, "GCodeDefinitions", "countSheet.json")

    nozzle_dia = 0.0

    str = ss.file_count(nozzle_dia, count_file)

    date = time.strftime("%Y%m%d")

    if extra_name:
    
        file_name = "{}_{}_{}.gcode".format(str, date, extra_txt)
    
    else:
    
        file_name = "{}_{}.gcode".format(str, date)

    save_file = os.path.join(folder_path, file_name)

    print save_file

    data = '\n'.join(data)

    tmp_file = open(save_file, "a")
    tmp_file.write(data)
    tmp_file.close()
# ---------- end python_9 ----------
move_2 = Move(Geometry=demesh_3.Vertices, Motion=multiplication_3)  # -> Geometry, Transform
conmesh_2 = ConstructMesh(Vertices=move_2.Geometry, Faces=demesh_3.Faces, Colours=gradient)
Z_3 = UnitZ(Factor=Slider(1, range=0..1))
panel_6 = Panel(python_9.out)
contour = Contour(Shape=conmesh_2, Point=Z_3, Direction=Vector(0, 0, 1), Distance=Slider(2.5, range=0..10))  # -> flatten(Contours)
cls = Closed(Curve=contour)  # -> Closed, Periodic
wbedges_2 = WeaverbirdsMeshEdges(MeshOrPolylines=conmesh_2)
sift = SiftPattern(List=contour, SiftPattern=cls.Closed)  # -> Output0, Output1
clscrv = CloseCurve(Curve=contour, CloseType=0, Bulge=0.5, Tolerance=0.01)  # -> Closed, R
clean = CleanTree(RemoveNulls=True, RemoveInvalid=True, RemoveEmpty=False, Tree=sift.Output1)
python_10 = GhPythonScript(crvs=clean)  # -> out, crvs, start_pt_0; inputs crvs: list of Curve
# ---------- python_10: Python ----------
import Rhino.Geometry as rg

start_pt = crvs[0].PointAtStart
start_pt_0 = rg.Point3d(start_pt)

for crv in crvs:
    
    _, t_val = crv.ClosestPoint(start_pt)
    
    start_pt = crv.PointAt(t_val)
    crv.ChangeClosedCurveSeam(t_val)
# ---------- end python_10 ----------
pt_12 = Point(python_10.start_pt_0)
divide_4 = DivideCurve(Curve=python_10.crvs, Count=1, Kinks=True)  # -> Points, Tangents, Parameters
branch = TreeBranch(Tree=divide_4.Points, Path="{0;0;0}", MaintainPaths=True)
item_4 = ListItem(List=divide_4.Points, Index=0, Wrap=True)
crv_10 = Curve(item_4)
item_5 = ListItem(List=flatten(divide_4.Points), Index=0, Wrap=True)  # -> Item1, Item
pdecon_2 = Deconstruct(Point=item_5.Item1)  # -> XComponent, YComponent, ZComponent
addition_2 = Addition(A=Slider(25, range=0..100), B=pdecon_2.ZComponent)
pt_13 = ConstructPoint(XCoordinate=pdecon.XComponent, YCoordinate=pdecon.YComponent, ZCoordinate=addition_2)
panel_7 = Panel(end_start_gcode.out)
pline_4 = PolyLine(Vertices=flatten(divide_4.Points), Closed=False)

# ==== cluster Cluster
C = ClusterInput()
M = ClusterInput()
demesh = DeconstructMesh(Mesh=M)  # -> Vertices, Faces, Colours, Normals
crv_cp = CurveClosestPoint(Point=graft(demesh.Vertices), Curve=C)  # -> Point, Parameter, Distance
dist = Distance(PointA=graft(demesh.Vertices), PointB=crv_cp.Point)
eval = EvaluateCurve(Curve=C, Parameter=crv_cp.Parameter)  # -> Point, Tangent, Angle
sort = SortList(Keys=dist, ValuesA=eval.Tangent)  # -> Keys, simplify(ValuesA)
item = ListItem(List=sort.ValuesA, Index=0, Wrap=True)  # -> flatten(Item)
xprod = CrossProduct(VectorA=item, VectorB=demesh.Normals, Unitize=False)  # -> Vector, Length
xprod_2 = CrossProduct(VectorA=xprod.Vector, VectorB=demesh.Normals, Unitize=False)  # -> Vector, Length
expression = Expression(x=xprod_2.Length, Expression="if(x=0,1,0)")
X = UnitX(Factor=1)
p_n_c = PickNChoose(Pattern=expression, Stream0=xprod_2.Vector, Stream1=X)
R = ClusterOutput(p_n_c)
