# Grasshopper definition TripodCup.gh (Grasshopper 1.0.7)

crv = Curve([<curve referenced from the Rhino model> x3])
crv_2 = Curve([<curve referenced from the Rhino model> x3])

# ---- group: small rotated 240
geo = Geometry([Point(-13.5, -23.3826859, 0), Point(-13.50040109, -21.18338062, 0.01785714286), Point(-11.99817424, -18.58144739, 0.03571428571), Point(-10.49594739, -15.97951416, 0.05357142857), Point(-8.993720544, -13.37758093, 0.07142857143), Point(-7.491493694, -10.7756477, 0.08928571429)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])

# ----
end = EndPoints(Curve=crv)  # -> Start, End
item = ListItem(List=crv_2, Index=0, Wrap=True)  # -> Item, Item1, Item2, Item3
len = Length()
rev = Reverse()
pt = Point(end.Start)
pt_2 = Point(end.End)
flip = FlipCurve(Curve=item.Item)  # -> Curve, Flag
crv_3 = Curve(crv)
num = Number(Slider(1.5, range=0..10))
neg = Negative(Value=num)
offset = OffsetCurve(Curve=crv_3, Distance=graft([num, neg]), Plane=PlaneXY(0, 0, 0), Corners=1)
crv_cp = CurveClosestPoint(Point=pt, Curve=item.Item)  # -> Point, Parameter, Distance
crv_cp_2 = CurveClosestPoint(Point=crv_cp.Point, Curve=item.Item1)  # -> Point, Parameter, Distance
crv_cp_3 = CurveClosestPoint(Point=crv_cp_2.Point, Curve=item.Item2)  # -> Point, Parameter, Distance
crv_cp_4 = CurveClosestPoint(Point=crv_cp_3.Point, Curve=item.Item3)  # -> Point, Parameter, Distance; disabled
path_mapper = PathMapper(offset, source="{A;B;C}", target="{C}")
number_slider = Slider(1, range=0..10)  # disabled
shatter = Shatter(Curve=item.Item, Parameters=crv_cp.Parameter)  # -> flatten(Segments)
shatter_2 = Shatter(Curve=item.Item1, Parameters=crv_cp_2.Parameter)  # -> flatten(Segments)
shatter_3 = Shatter(Curve=item.Item2, Parameters=crv_cp_3.Parameter)  # -> flatten(Segments)
shatter_4 = Shatter(Curve=item.Item3, Parameters=crv_cp_4.Parameter)  # -> flatten(Segments); disabled
end_2 = EndPoints(Curve=path_mapper)  # -> Start, End
shift = ShiftList(List=shatter, Shift=Slider(1, range=0..10), Wrap=True)  # -> graft(List)
crv_4 = Curve(path_mapper)
shift_2 = ShiftList(List=shatter_2, Shift=Slider(0, range=0..10), Wrap=True)  # -> graft(List)
shift_3 = ShiftList(List=shatter_3, Shift=Slider(1, range=0..10), Wrap=True)  # -> graft(List)
shift_4 = ShiftList(List=shatter_4, Shift=number_slider, Wrap=True)  # -> graft(List); disabled
item_2 = ListItem(List=end_2.Start, Index=0, Wrap=True)  # -> Item, Item1
item_3 = ListItem(List=end_2.End, Index=0, Wrap=True)  # -> Item, Item1
path_mapper_2 = PathMapper(shift, source="{A;B;C}", target="{C}")
path_mapper_3 = PathMapper(shift_3, source="{A;B;C}", target="{C}")
path_mapper_4 = PathMapper(shift_2, source="{A;B;C}", target="{C}")
path_mapper_5 = PathMapper(shift_4, source="{A;B;C}", target="{C}")  # disabled
crv_5 = Curve()
ln = Line(StartPoint=item_3.Item, EndPoint=item_3.Item1)
ln_2 = Line(StartPoint=item_2.Item, EndPoint=item_2.Item1)
merge = Merge(Data1=crv_4, Data2=ln_2, Data3=ln)
join = JoinCurves(Curves=merge, Preserve=False)
runion = RegionUnion(Curves=flatten(join))
flip_2 = FlipCurve(Curve=runion)  # -> Curve, Flag
crv_cp_5 = CurveClosestPoint(Point=pt, Curve=flip_2.Curve)  # -> Point, Parameter, Distance
shatter_5 = Shatter(Curve=flip_2.Curve, Parameters=crv_cp_5.Parameter)  # -> flatten(Segments)
shift_5 = ShiftList(List=shatter_5, Shift=Slider(2, range=0..10), Wrap=True)  # -> graft(List)
path_mapper_6 = PathMapper(shift_5, source="{A;B;C}", target="{C}")
merge_2 = Merge(Data1=path_mapper_6, Data2=path_mapper_2)
merge_3 = Merge(Data1=path_mapper_6, Data2=path_mapper_2, Data3=path_mapper_4, Data4=path_mapper_3, Data5=path_mapper_5)
loft = Loft(Curves=merge_3, Options={Adjust=True, Closed=False, LoftEnds=0, LoftSimp=0, LoftType=0, Rebuild=2, Refit=0.01})  # -> flatten(Loft)
brep = Brep()
item_4 = ListItem(List=loft, Index=0, Wrap=True)
number_slider_2 = Slider(2.5, range=0..10)
item_5 = ListItem(List=loft, Index=1, Wrap=True)
contour = Contour(Shape=loft, Point=Point(0, 0, 0.01), Direction=Vector(0, 0, 1), Distance=number_slider_2)
divide = DivideCurve(Curve=contour, Count=Slider(0, range=0..100), Kinks=True)  # -> Points, Tangents, Parameters
rev_2 = ReverseList(List=divide.Points)
path_mapper_7 = PathMapper(rev_2, source="{A;B;C}", target="{B}")
python = GhPythonScript(pts=path_mapper_7, layer_height=number_slider_2)  # -> out, new_pts; inputs pts: list of Point3d
# ---------- python: Python ----------
import Rhino.Geometry as rg

count = float(len(pts))
delta = layer_height / count

new_pts = []

for pt_i, pt in enumerate(pts):
    
    z_scale = 1.0
    
    new_pts.append(rg.Point3d(
        pt[0],
        pt[1],
        pt[2] * z_scale + delta * pt_i
    ))
# ---------- end python ----------
